# Grasshopper definition PLAN_PROCESS.gh (Grasshopper 0.9.76)
# plug-ins: DataColorSimilarity, ImageClass

path = FilePath(["F:\360-analysis\images\popular\[Extreme] 360° RollerCoaster at Seoul Grand Park-8lsB-P8nGSM-1.jpg", "F:\360-analysis\images\popular\[Extreme] 360° RollerCoaster at Seoul Grand Park-8lsB-P8nGSM-2.jpg", "F:\360-analysis\images\popular\[Extreme] 360° RollerCoaster at Seoul Grand Park-8lsB-P8nGSM-3.jpg", "F:\360-analysis\images\popular\[Extreme] 360° RollerCoaster at Seoul Grand Park-8lsB-P8nGSM-4.jpg", "F:\360-analysis\images\popular\[Extreme] 360° RollerCoaster at Seoul Grand Park-8lsB-P8nGSM-5.jpg", "F:\360-analysis\images\popular\[Extreme] 360° RollerCoaster at Seoul Grand Park-8lsB-P8nGSM-6.jpg"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])
number_slider = Slider(1, range=0..1)  # disabled
number_slider_2 = Slider(0, range=0..77)  # disabled
item = ListItem(List=path, Index=Slider(124, range=0..150), Wrap=True)
imload = ImageLoad(Path=item)  # -> Image, W, H, PreviewGUID
imageerosion = ImageErosion(
    Image=imload.Image,
    Threshold=Slider(43, range=0..1000),
    Iterations=Slider(11, range=0..20),
    NoiseRemovalO=Slider(0.155, range=0..1),
    CumulativeO=number_slider_2,
    ContourChainO=number_slider)  # -> Crvs, ContainmentBranch, ContainmentItem, Image

# ----
# ROOM STATS
lng = ListLength(List=imageerosion.Crvs)
area = Area(Geometry=imageerosion.Crvs)  # -> Area, Centroid
dom = ConstructDomain(DomainStart=Slider(5, range=0..10), DomainEnd=lng)
subset = SubList(List=area.Area, Domain=dom, Wrap=False)  # -> List, Index
datahistogram = DataHistogram(Values=subset.List, NumberOfBins=Slider(81, range=0..100))  # -> BinnedValues, BinValues

# ----
# DISPLAY ROOMS
sqgrid = Square(Plane=PlaneXY(0, 0, 0), Size=Slider(393, range=0..2000), ExtentX=5, ExtentY=5)  # -> Cells, flatten(Points)
subtraction = Subtraction(A=sqgrid.Points, B=area.Centroid)
move = Move(Geometry=imageerosion.Crvs, Motion=subtraction)  # -> Geometry, Transform

graph = QuickGraph(datahistogram.BinnedValues)
